# Dynamo graph office-space-optimization.dyn (Dynamo 3.3.0.6316)

# group: Add desks
elementType = Element.ElementType()  # unwired: element
family_types = FamilyTypes("Desk-Executive:Desk-Executive")
select_model_element = DSModelElementSelection()  # 1 picked in the model
boundingBox = Element.BoundingBox(element=select_model_element)
minPoint = BoundingBox.MinPoint(boundingBox=boundingBox)
X = Point.X(point=minPoint)
integer_slider = IntegerSlider(10, range=0..100 step 1)
add = X + integer_slider
maxPoint = BoundingBox.MaxPoint(boundingBox=boundingBox)
X_2 = Point.X(point=maxPoint)
number_slider = DoubleSlider(15, range=0..100 step 0.1)
range = Range(start=add, end=X_2, step=number_slider)
Y = Point.Y(point=minPoint)
add_2 = Y + integer_slider
Y_2 = Point.Y(point=maxPoint)
number_slider_2 = DoubleSlider(20, range=0..100 step 0.1)
range_2 = Range(start=add_2, end=Y_2, step=number_slider_2)

byCoordinates = Point.ByCoordinates(x=range, y=range_2, lacing=CrossProduct)

# group (continued): Add desks
byPoint = FamilyInstance.ByPoint(familyType=family_types, point=byCoordinates)

# group: Add chairs
elementType_2 = Element.ElementType()  # unwired: element
family_types_2 = FamilyTypes("Chair-Executive:Chair-Executive")
select_model_element_2 = DSModelElementSelection()  # 1 picked in the model
boundingBox_2 = Element.BoundingBox(element=select_model_element_2)
minPoint_2 = BoundingBox.MinPoint(boundingBox=boundingBox_2)
X_3 = Point.X(point=minPoint_2)
integer_slider_2 = IntegerSlider(10, range=0..100 step 1)
add_3 = X_3 + integer_slider_2
maxPoint_2 = BoundingBox.MaxPoint(boundingBox=boundingBox_2)
X_4 = Point.X(point=maxPoint_2)
number_slider_3 = DoubleSlider(15, range=0..100 step 0.1)
range_3 = Range(start=add_3, end=X_4, step=number_slider_3)
Y_3 = Point.Y(point=minPoint_2)
integer_slider_3 = IntegerSlider(13, range=0..100 step 1)
add_4 = Y_3 + integer_slider_3
Y_4 = Point.Y(point=maxPoint_2)
number_slider_4 = DoubleSlider(20, range=0..100 step 0.1)
range_4 = Range(start=add_4, end=Y_4, step=number_slider_4)
number = DoubleInput(180)

byCoordinates_2 = Point.ByCoordinates(x=range_3, y=range_4, lacing=CrossProduct)

# group (continued): Add chairs
byPoint_2 = FamilyInstance.ByPoint(familyType=family_types_2, point=byCoordinates_2)
setRotation = FamilyInstance.SetRotation(familyInstance=byPoint_2, degree=number)
